# Grasshopper definition buildings3.gh (Grasshopper 1.0.7)
# plug-ins: Pufferfish

number_slider = Slider(0, range=0..32)
int = Integer(Slider(8, range=0..8))
num = Number(number_slider)

# ---- group: support
trudeau = Curve([<curve referenced from the Rhino model> x10])

# ---- group: thank
crv = Curve([<curve referenced from the Rhino model> x6])

# ---- group: trudeau
crv_2 = Curve([<curve referenced from the Rhino model> x10])

# ----
love = Curve([<curve referenced from the Rhino model> x6])
gov = Curve([<curve referenced from the Rhino model> x13])
death = Curve([<curve referenced from the Rhino model> x8])
school = Curve([<curve referenced from the Rhino model> x8])

# ---- group: help
crv_3 = Curve([<curve referenced from the Rhino model> x6])

# ---- group: housing
crv_4 = Curve([<curve referenced from the Rhino model> x9])

# ---- group: vaccine
crv_5 = Curve([<curve referenced from the Rhino model> x10])

# ---- group: restrictions
crv_6 = Curve([<curve referenced from the Rhino model> x16])

# ----
boundary = BoundarySurfaces(Edges=crv)
boundary_2 = BoundarySurfaces(Edges=gov)
boundary_3 = BoundarySurfaces(Edges=trudeau)
boundary_4 = BoundarySurfaces(Edges=crv_2)
boundary_5 = BoundarySurfaces(Edges=crv_4)
boundary_6 = BoundarySurfaces(Edges=crv_3)
boundary_7 = BoundarySurfaces(Edges=crv_5)
boundary_8 = BoundarySurfaces(Edges=love)

boundary_9 = BoundarySurfaces(Edges=school)

panel = Panel("""0
0
0
0
0
0
0
1
18""")
panel_2 = Panel("""8
4
3
11
3
1
4
4
0""")
panel_3 = Panel("""6
0
14
7
8
2
5
9
0""")
panel_4 = Panel("""0
0
0
0
0
0
3
4
23""")
panel_5 = Panel("""0
0
0
0
0
0
0
5
29""")
panel_6 = Panel("""16
9
4
6
7
3
2
1
0""")
panel_7 = Panel("""0
0
0
0
0
0
10
0
12""")
panel_8 = Panel("""0
0
16
0
5
0
5
2
0""")
panel_9 = Panel("""0
0
0
0
0
0
0
0
21""")
panel_10 = Panel("""0
0
0
0
0
0
1
0
16""")
panel_11 = Panel("""0
0
0
0
0
0
0
0
55""")

boundary_10 = BoundarySurfaces(Edges=crv_6)
boundary_11 = BoundarySurfaces(Edges=death)
panel_12 = Panel("""0.5
8.21
3.25
7.3
2.5
0.03
3.8
1.5
1.18""")
# Use this slider to change the size of words/ num of birds
number_slider_2 = Slider(1, range=1..25)

# ---- group: bird
brep = Brep([<brep referenced from the Rhino model> x2])

# ----
mesh = Mesh([<mesh referenced from the Rhino model> x3])
dom = ConstructDomain(DomainStart=Slider(0.03, range=0..0.1), DomainEnd=Slider(8.21, range=0..10))
dom_2 = ConstructDomain(DomainStart=Slider(1, range=0..2), DomainEnd=Slider(1.39, range=0..2))
flatten = FlattenTree(Tree=mesh, Path="{0}")
remap = RemapNumbers(Value=panel_12, Source=dom, Target=dom_2)  # -> Mapped, Clipped

twnconnums = TweenConsecutiveNumbers(Numbers=remap.Mapped, Factor=0.5)
weave = Weave(Pattern=[0, 1], Stream0=remap.Mapped, Stream1=twnconnums, NullGaps=False)
twnconnums_2 = TweenConsecutiveNumbers(Numbers=weave, Factor=0.5)
weave_2 = Weave(Pattern=[0, 1], Stream0=weave, Stream1=twnconnums_2, NullGaps=False)
panel_13 = Panel(weave_2)

group = Group(Objects=flatten)
panel_14 = Panel("""1.058606
1.298955
1.539303
1.779652
2.02
1.865379
1.710758
1.556137
1.401516
1.527769
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""")
bbox = BoundingBox(Content=group, Plane=PlaneXY(0, 0, 0))  # -> Box, Box_2
panel_15 = Panel("""16
14.25
12.5
10.75
9
7.75
6.5
5.25
4
4.5
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""")
panel_16 = Panel("""6
4.5
3
1.5
0
3.5
7
10.5
14
12.25
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""")
panel_17 = Panel("""8
7
6
5
4
3.75
3.5
3.25
3
5
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""")
panel_18 = Panel("""0
0
0
0
0
0
0
0
0
0
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""")
dam = DataDam(DataA=bbox.Box, BufferDelay=10000000, BufferMode=0)
panel_19 = Panel("""0
0
0
0
0
0
0
0
0
0
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""")
panel_20 = Panel("""0
0
0
0
0
0
0
0
0
0
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""")
panel_21 = Panel("""0
0
0
0
0
4
8
12
16
12
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""")
panel_22 = Panel("""0
0
0
0
0
0
0
0
0
0
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""")
panel_23 = Panel("""0
0
0
0
0
0
0
0
0
0
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""")
panel_24 = Panel("""0
0
0
0
0
0
0
0
0
0
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""")
panel_25 = Panel("""0
0
0
0
0
0
0
0
0
0
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""")
bbox_2 = BoundingBox(Content=brep, Plane=PlaneXY(0, 0, 0))  # -> Box, Box_2

list_item = ListItem(List=panel_15, Index=num, Wrap=True)
list_item_2 = ListItem(List=panel_16, Index=num, Wrap=True)
list_item_3 = ListItem(List=panel_17, Index=num, Wrap=True)
list_item_4 = ListItem(List=panel_21, Index=num, Wrap=True)
list_item_5 = ListItem(List=panel_20, Index=num, Wrap=True)
list_item_6 = ListItem(List=panel_24, Index=num, Wrap=True)
list_item_7 = ListItem(List=panel_23, Index=num, Wrap=True)
list_item_8 = ListItem(List=panel_18, Index=num, Wrap=True)
list_item_9 = ListItem(List=panel_19, Index=num, Wrap=True)
list_item_10 = ListItem(List=panel_22, Index=num, Wrap=True)
list_item_11 = ListItem(List=panel_25, Index=num, Wrap=True)

dom_3 = ConstructDomain(DomainStart=Slider(1, range=1..25), DomainEnd=Slider(25, range=1..25))
num_birds = Slider(14, range=8..20)
list_item_12 = ListItem(List=panel_14, Index=num, Wrap=True)

# ---- group: flat roof surface
srf = Surface([<surface referenced from the Rhino model> x5])

# ----
debrep = DeconstructBrep(Brep=dam)  # -> Faces, Edges, Vertices

Z = UnitZ(Factor=list_item)
Z_2 = UnitZ(Factor=list_item_2)
Z_3 = UnitZ(Factor=list_item_3)
Z_4 = UnitZ(Factor=list_item_7)
Z_5 = UnitZ(Factor=list_item_8)
Z_6 = UnitZ(Factor=list_item_4)
Z_7 = UnitZ(Factor=list_item_9)
Z_8 = UnitZ(Factor=list_item_5)
Z_9 = UnitZ(Factor=list_item_6)
Z_10 = UnitZ(Factor=list_item_10)
Z_11 = UnitZ(Factor=list_item_11)

num_2 = Number(number_slider)
num_3 = Number(Slider(32, range=0..32))
point = Point(<point referenced from the Rhino model>)
mesh_2 = Mesh([<mesh referenced from the Rhino model> x381])
sdivide = DivideSurface(Surface=srf, UCount=num_birds, VCount=num_birds)  # -> flatten(Points), Normals, Parameters
item = ListItem(List=flatten(debrep.Faces), Index=Slider(10, range=0..15), Wrap=True)
scale = Scale(Geometry=mesh_2, Center=point, Factor=list_item_12)  # -> Geometry, Transform
lng = ListLength(List=panel_14)
xy = XYPlane(Origin=sdivide.Points)
area = Area(Geometry=item)  # -> Area, Centroid

extr = Extrude(Base=boundary_3, Direction=Z)
extr_2 = Extrude(Base=boundary, Direction=Z_2)
extr_3 = Extrude(Base=boundary_6, Direction=Z_3)
extr_4 = Extrude(Base=boundary_8, Direction=Z_6)
extr_5 = Extrude(Base=boundary_4, Direction=Z_9)
extr_6 = Extrude(Base=boundary_10, Direction=Z_7)
extr_7 = Extrude(Base=boundary_2, Direction=Z_4)
extr_8 = Extrude(Base=boundary_5, Direction=Z_11)
extr_9 = Extrude(Base=boundary_11, Direction=Z_8)
extr_10 = Extrude(Base=boundary_7, Direction=Z_10)
extr_11 = Extrude(Base=boundary_9, Direction=Z_5)

number_slider_3 = Slider(0, range=0..100)
number_slider_4 = Slider(140, range=0..255)
crv_7 = Curve(<curve referenced from the Rhino model>)

cap = CapHoles(Brep=extr)
cap_2 = CapHoles(Brep=extr_2)
cap_3 = CapHoles(Brep=extr_3)
cap_4 = CapHoles(Brep=extr_4)
cap_5 = CapHoles(Brep=extr_5)
cap_6 = CapHoles(Brep=extr_6)
cap_7 = CapHoles(Brep=extr_7)
cap_8 = CapHoles(Brep=extr_8)
cap_9 = CapHoles(Brep=extr_9)
cap_10 = CapHoles(Brep=extr_10)
cap_11 = CapHoles(Brep=extr_11)

divide = DivideCurve(Curve=crv_7, Count=Slider(100, range=0..100), Kinks=False)  # -> Points, Tangents, Parameters
xy_2 = XYPlane(Origin=area.Centroid)
hsl = ColourHSL(Alpha=1, Hue=Slider(0.8, range=0..1), Saturation=Slider(1, range=0..1), Luminance=Slider(0.6, range=0..1))
orient = Orient(Geometry=brep, Source=xy_2, Target=xy)  # -> Geometry, Transform; disabled
xy_3 = XYPlane(Origin=divide.Points)
rgb = ColourRGB(Alpha=255, Red=number_slider_3, Green=number_slider_3, Blue=number_slider_3)
rgb_2 = ColourRGB(Alpha=255, Red=number_slider_4, Green=number_slider_4, Blue=number_slider_4)
orient_2 = Orient(Geometry=group, Source=xy_2, Target=xy_3)  # -> Geometry, Transform
lng_2 = ListLength(List=orient_2.Geometry)
dom_4 = ConstructDomain(DomainStart=Slider(1, range=0..1), DomainEnd=lng_2)
remap_2 = RemapNumbers(Value=number_slider_2, Source=dom_3, Target=dom_4)  # -> Mapped, Clipped
python = GhPythonScript(birds_give=orient_2.Geometry, num=num_2)  # -> out, birds_to_show; inputs birds_give: list
# ---------- python: Python ----------
__author__ = "Francis Banares"
__version__ = "2020.12.05"

import rhinoscriptsyntax as rs

def create_list(num):
    start = 0
    return_list = []
    while start < num:
        return_list.append(start)
        start += 1
    return return_list


birds_given = birds_give
birds_to_show 
num = int(num)

if num < 10:
    #birds_to_show = birds_given[0:num]
    birds_to_show = create_list(num)
elif num < 20:
    #birds_to_show = birds_given[0:num + 40]
    birds_to_show = create_list(num + 40)
elif num < 25:
    #birds_to_show = birds_given[0:num + 40]
    birds_to_show = create_list(num + 40+ 10)
elif num <33:
    #birds_to_show = birds_given[0:num + 40 + 30]
    birds_to_show = create_list(num+ 40 + 19)
# ---------- end python ----------
series = Series(Start=0, Step=Slider(1, range=0..1), Count=remap_2.Mapped)
lng_3 = ListLength(List=orient_2.Geometry)
preview = CustomPreview(Geometry=scale.Geometry, Material=rgb_2)  # disabled
python_2 = GhPythonScript(all_birds=orient.Geometry, num_birds=num_birds, num_display=number_slider_2)  # -> out, a, birds_show; inputs all_birds: list
# ---------- python_2: Python ----------
__author__ = "Francis Banares"
__version__ = "2020.12.02"

import rhinoscriptsyntax as rs

total_num_birds = num_birds * num_birds
birds_show = []

#take num scale and actually decide how much we wanna show. make it logarithmic
num = int(num_display)
if num < 30:
    birds_show = total_num_birds[0:(int(num))]
elif num > 31 and num <96:
    birds_show = total_num_birds[0:num + 100]
# ---------- end python_2 ----------
preview_2 = CustomPreview(Geometry=[crv_4, crv_5, crv_6, death, school, gov, love, crv_2, crv_3, crv, trudeau], Material=rgb)
item_2 = ListItem(List=orient_2.Geometry, Index=series, Wrap=True)
split = SplitList(List=orient_2.Geometry)  # -> ListA, ListB
item_3 = ListItem(List=orient_2.Geometry, Index=python.birds_to_show, Wrap=True)
create_material = CreateMaterial(
    Diffuse=RGBA(255, 150, 215, 57),
    Specular=RGB(255, 255, 255),
    Emission=RGB(0, 0, 0),
    Transparency=Slider(0.5, range=0..1),
    Shine=0)
create_material_2 = CreateMaterial(
    Diffuse=RGBA(153, 236, 255, 57),
    Specular=RGB(255, 255, 255),
    Emission=RGB(0, 0, 0),
    Transparency=Slider(0.5, range=0..1),
    Shine=0)
create_material_3 = CreateMaterial(
    Diffuse=RGBA(200, 140, 230, 57),
    Specular=RGB(255, 255, 255),
    Emission=RGB(0, 0, 0),
    Transparency=Slider(0.5, range=0..1),
    Shine=0)
create_material_4 = CreateMaterial(
    Diffuse=RGBA(252, 240, 129, 133),
    Specular=RGBA(255, 255, 255, 242),
    Emission=RGB(247, 247, 2),
    Transparency=Slider(0.5, range=0..1),
    Shine=0)
create_material_5 = CreateMaterial(
    Diffuse=RGBA(255, 150, 189, 199),
    Specular=RGB(255, 255, 255),
    Emission=RGB(117, 0, 0),
    Transparency=Slider(0.5, range=0..1),
    Shine=0)
create_material_6 = CreateMaterial(
    Diffuse=RGBA(197, 198, 199, 110),
    Specular=RGB(255, 255, 255),
    Emission=RGB(0, 0, 0),
    Transparency=Slider(0.5, range=0..1),
    Shine=0)
create_material_7 = CreateMaterial(
    Diffuse=RGBA(255, 159, 128, 57),
    Specular=RGB(255, 255, 255),
    Emission=RGB(0, 0, 0),
    Transparency=Slider(0.5, range=0..1),
    Shine=0)
create_material_8 = CreateMaterial(
    Diffuse=RGBA(0, 0, 0, 57),
    Specular=RGB(255, 255, 255),
    Emission=RGB(0, 0, 0),
    Transparency=Slider(0.5, range=0..1),
    Shine=0)
create_material_9 = CreateMaterial(
    Diffuse=RGBA(147, 255, 212, 110),
    Specular=RGB(255, 255, 255),
    Emission=RGB(0, 0, 0),
    Transparency=Slider(0.5, range=0..1),
    Shine=0)
create_material_10 = CreateMaterial(
    Diffuse=RGBA(255, 31, 43, 199),
    Specular=RGB(255, 255, 255),
    Emission=RGB(63, 0, 0),
    Transparency=Slider(0.5, range=0..1),
    Shine=0)
create_material_11 = CreateMaterial(
    Diffuse=RGBA(30, 172, 207, 133),
    Specular=RGBA(255, 255, 255, 242),
    Emission=RGB(0, 49, 213),
    Transparency=Slider(0.5, range=0..1),
    Shine=0)
rgb_3 = ColourRGB(Alpha=255, Red=Slider(0, range=0..1000), Green=Slider(0, range=0..1000), Blue=Slider(104, range=0..1000))
preview_3 = CustomPreview(Geometry=item_2, Material=rgb_3)
preview_4 = CustomPreview(Geometry=cap_2, Material=create_material)
preview_5 = CustomPreview(Geometry=cap, Material=create_material_2)
rgb_4 = ColourRGB(Alpha=255, Red=Slider(0, range=0..1000), Green=Slider(0, range=0..1000), Blue=Slider(257, range=0..1000))
preview_6 = CustomPreview(Geometry=cap_3, Material=create_material_3)
preview_7 = CustomPreview(Geometry=cap_7, Material=create_material_4)
preview_8 = CustomPreview(Geometry=cap_4, Material=create_material_5)
preview_9 = CustomPreview(Geometry=cap_5, Material=create_material_6)
preview_10 = CustomPreview(Geometry=cap_11, Material=create_material_7)
preview_11 = CustomPreview(Geometry=cap_9, Material=create_material_8)
preview_12 = CustomPreview(Geometry=item_3, Material=rgb_4)
preview_13 = CustomPreview(Geometry=cap_10, Material=create_material_9)
preview_14 = CustomPreview(Geometry=cap_6, Material=create_material_10)
preview_15 = CustomPreview(Geometry=cap_8, Material=create_material_11)
